# Grasshopper definition json-convertor.gh (Grasshopper 1.0.8)

geometry_pipeline = GeometryPipeline(
    GroupByLayer=False,
    GroupByType=False,
    IncludeHidden=True,
    IncludeLocked=True,
    LayerFilter="Drawing",
    NameFilter="*",
    SublayerFiltering=True,
    TypeFilter=4)
geometry_pipeline_2 = GeometryPipeline(
    GroupByLayer=False,
    GroupByType=False,
    IncludeHidden=True,
    IncludeLocked=True,
    LayerFilter="Frame",
    NameFilter="*",
    SublayerFiltering=True,
    TypeFilter=4)
geometry_pipeline_3 = GeometryPipeline(
    GroupByLayer=False,
    GroupByType=False,
    IncludeHidden=True,
    IncludeLocked=True,
    LayerFilter="BIM",
    NameFilter="*",
    SublayerFiltering=True,
    TypeFilter=4)
python_3_script = Python3Script(Drawing=geometry_pipeline, Frame=geometry_pipeline_2, BIM=geometry_pipeline_3)  # -> out, JSON_String; inputs Drawing: list, Frame: list
# ---------- python_3_script: Python ----------
import Rhino
import Rhino.Geometry as rg
import rhinoscriptsyntax as rs
import scriptcontext as sc
import System
import os, json

def to_curve(obj):
    if isinstance(obj, rg.Curve):
        return obj
    elif isinstance(obj, System.Guid):
        return rs.coercecurve(obj)
    return None

def curve_to_points(curve, points_per_unit=1.0, min_segments=2, max_segments=10000):
    if not curve: return []
    # Calculate segments dynamically based on length * density, with bounds
    length = curve.GetLength() or 0.0
    segments = int(round(length * points_per_unit))
    if segments < min_segments:
        segments = min_segments
    if segments > max_segments:
        segments = max_segments

    # For closed curves, avoid duplicate end points
    include_end = not curve.IsClosed
    t_vals = curve.DivideByCount(segments, include_end)
    if not t_vals: return []
    pts = [curve.PointAt(t) for t in t_vals]
    return [[round(p.X,3), round(p.Y,3)] for p in pts]

def check_curve_frame_intersection(curve, frame_bbox):
    """Check if a curve intersects with or is contained by a frame's bounding box (2D XY)."""
    if not curve or not frame_bbox: return False

    # Helpers for 2D bbox tests (XY only)
    def aabb_overlap_xy(bb1, bb2):
        return not (
            bb1.Max.X < bb2.Min.X or
            bb1.Min.X > bb2.Max.X or
            bb1.Max.Y < bb2.Min.Y or
            bb1.Min.Y > bb2.Max.Y
        )

    def bbox_contains_bbox_xy(outer, inner):
        return (
            inner.Min.X >= outer.Min.X and inner.Max.X <= outer.Max.X and
            inner.Min.Y >= outer.Min.Y and inner.Max.Y <= outer.Max.Y
        )

    def point_in_bbox_xy(pt, bb):
        return (
            pt.X >= bb.Min.X and pt.X <= bb.Max.X and
            pt.Y >= bb.Min.Y and pt.Y <= bb.Max.Y
        )

    # Get curve's bounding box
    curve_bbox = curve.GetBoundingBox(True)

    # First check if bounding boxes overlap at all
    if not aabb_overlap_xy(curve_bbox, frame_bbox):
        return False

    # If curve's bbox is fully contained, consider it inside
    if bbox_contains_bbox_xy(frame_bbox, curve_bbox):
        return True

    # Otherwise, sample points on the curve to see if any lies within frame
    points = curve_to_points(curve, points_per_unit=2.0)  # denser sampling
    for pt in points:
        if point_in_bbox_xy(rg.Point3d(pt[0], pt[1], 0), frame_bbox):
            return True

    return False

def curve_to_json(curve, frame_id=None, color="#000000", strokeWidth=2):
    crv = to_curve(curve)
    if not crv: return {}
    pts = curve_to_points(crv)
    return {
        "type": "curve",
        "points": pts,
        "closed": bool(getattr(crv, 'IsClosed', False)),
        "style": {
            "stroke": color,
            "strokeWidth": strokeWidth
        },
        "parentFrameId": frame_id  # Add parent frame reference
    }

def rect_to_json(rect_like, name="Frame", index=0):
    """Convert a Rectangle-like input to a frame json with a unique ID."""
    bbox = None
    if isinstance(rect_like, rg.Rectangle3d):
        bbox = rect_like.BoundingBox
    elif isinstance(rect_like, rg.BoundingBox):
        bbox = rect_like
    else:
        crv = to_curve(rect_like)
        if crv:
            bbox = crv.GetBoundingBox(True)
    if not bbox:
        return {}
    min_pt = bbox.Min
    max_pt = bbox.Max
    frame_id = f"frame_{index}"  # Generate unique frame ID
    return {
        "type": "frame",
        "id": frame_id,  # Add unique ID
        "name": name,
        "x": round(min_pt.X, 3),
        "y": round(min_pt.Y, 3),
        "width": round(max_pt.X - min_pt.X, 3),
        "height": round(max_pt.Y - min_pt.Y, 3),
        "bbox": bbox  # Temporary, will be removed before JSON serialization
    }

# Grasshopper inputs:
# Drawing = curves (single or multiple)
# Frame = frames (single or multiple)
results = []
frames = []
curves = []

# First process all frames to get their bounding boxes
try:
    has_frame = 'Frame' in globals() and Frame is not None
except NameError:
    has_frame = False

if has_frame:
    if isinstance(Frame, list):
        for i, fr in enumerate(Frame):
            fr_json = rect_to_json(fr, name=f"Frame {i + 1}", index=i)
            if fr_json:
                frames.append(fr_json)
    else:
        fr_json = rect_to_json(Frame, name="Frame", index=0)
        if fr_json:
            frames.append(fr_json)

# Then process all curves and check their containment
if Drawing:
    drawing_list = Drawing if isinstance(Drawing, list) else [Drawing]
    for crv in drawing_list:
        curve = to_curve(crv)
        if not curve:
            continue
            
        # Check intersection with all frames
        parent_frame_id = None
        for frame in frames:
            if check_curve_frame_intersection(curve, frame['bbox']):
                parent_frame_id = frame['id']
                break
                
        # Create curve JSON with parent frame reference
        curve_json = curve_to_json(curve, frame_id=parent_frame_id)
        if curve_json:
            curves.append(curve_json)

# Add frames to results first
for frame in frames:
    # Remove temporary bbox before adding to results
    frame_copy = frame.copy()
    frame_copy.pop('bbox', None)
    results.append(frame_copy)

# Then add curves
results.extend(curves)

# Convert to JSON string
json_string = json.dumps(results, indent=2)

# Write file
filepath = r"C:\2025_TT_Boston_Hackathon\01_app\02_figma-rhino-sync\backend\database\rhino-json-output\shapes.json"
os.makedirs(os.path.dirname(filepath), exist_ok=True)
with open(filepath, "w", encoding="utf-8") as f:
    f.write(json_string)

# Grasshopper output
JSON_String = json_string
# ---------- end python_3_script ----------
